# Grasshopper definition GRASSHOPPER_file.gh (Grasshopper 1.0.7)
# plug-ins: Human

層高調整 = Slider(360, range=0..1000)

# ----
# 文字圖層名稱
# (與RH一樣)
panel = Panel("text")

# ----
# 建築平面邊界
srf = Surface([<surface referenced from the Rhino model> x604])

dpipeline = DynamicGeometryPipeline(
    LayerFilter=panel,
    TypeFilter="text",
    NameFilter="*",
    GroupByLayer=False,
    GroupByType=False,
    IncludeHidden=True,
    IncludeLocked=True,
    enableFullPath=True,
    listenToAttributes=True)
srf_2 = Surface(srf)
# 分割資料
txtobjinfo = TextObjectInfo(TextObjects=dpipeline)  # -> Plane, Text, Size, Alignment, VerticalAlignment
wires = BrepWireframe(Brep=srf_2, Density=-1)
join = JoinCurves(Curves=wires, Preserve=False)
# 文字中心點位置
pt = Point(txtobjinfo.Plane)
txt = Text(txtobjinfo.Text)
crv = Curve(flatten(join))
# 確認點位與邊界相互對應
incurves = PointInCurves(Point=pt, Curves=crv)  # -> Relationship, Index, Point
# 重新篩選點位
equals = Equality(FirstNumber=incurves.Relationship, SecondNumber="0")  # -> Equality, Inequality
dispatch = Dispatch(List=txt, DispatchPattern=equals.Inequality)  # -> ListA, ListB
dispatch_2 = Dispatch(List=pt, DispatchPattern=equals.Inequality)  # -> ListA, ListB
txt_2 = Text(dispatch.ListA)
pt_2 = Point(dispatch_2.ListA)
len = TextLength(Text=txt_2)
equals_2 = Equality(FirstNumber=len, SecondNumber="2")  # -> Equality, Inequality
number_slider = Slider(0, range=0..100)
dispatch_3 = Dispatch(List=pt_2, DispatchPattern=equals_2.Equality)  # -> ListA, ListB
dispatch_4 = Dispatch(List=txt_2, DispatchPattern=equals_2.Equality)  # -> ListA, ListB
merge = Merge(Data1=dispatch_3.ListA, Data2=dispatch_3.ListB)
fragment = TextFragment(Text=dispatch_4.ListA, Start=number_slider, Count=Slider(1, range=0..1))
fragment_2 = TextFragment(Text=dispatch_4.ListB, Start=number_slider, Count=Slider(2, range=0..10))
# 重新排列點位
pt_3 = Point(merge)
merge_2 = Merge(Data1=fragment, Data2=fragment_2)
incurves_2 = PointInCurves(Point=pt_3, Curves=crv)  # -> Relationship, Index, Point
# 選擇邊界
item = ListItem(List=crv, Index=incurves_2.Index, Wrap=True)
srf_3 = Surface(item)
# 重新排列資訊
txt_3 = Text(merge_2)
clean = CleanTree(RemoveNulls=True, RemoveInvalid=True, RemoveEmpty=False, Tree=srf_3)
sort = SortList(Keys=txt_3)  # -> Keys, ValuesA
multiplication = Multiplication(A=層高調整, B=txt_3)
srf_4 = Surface(clean)
Z = UnitZ(Factor=multiplication)
item_2 = ListItem(List=sort.Keys, Index=0, Wrap=True)  # -> Item1, Item
extr = Extrude(Base=srf_4, Direction=Z)
cap = CapHoles(Brep=extr)

# ----
# 簡單高度分析
gradient = Gradient(
    LowerLimit=item_2.Item,
    UpperLimit=item_2.Item1,
    Parameter=txt_3,
    stops=[0: RGB(0, 128, 0), 0.5: RGB(255, 255, 0), 1: RGB(255, 0, 0)])
preview = CustomPreview(Geometry=cap, Material=gradient)

# ----
# 生成結果
brep = Brep(cap)
